# Dynamo graph AirTable-AddLine.dyn (Dynamo 2.6.0.8481)
# packages: DynaWeb 1.0.3

# group: Create the base request
code_block = CodeBlock { "https://api.airtable.com/v0/"; "appzH3UCTvVsrXqZU"; "doors"; }
code_block_2 = CodeBlock(airtableUrl=code_block.out0, baseId=code_block.out1, tableName=code_block.out2)
# ---------- code_block_2.designscript (3 lines) ----------
airtableUrl+
baseId+"/"+
tableName;
# ----------------------------------------
byUrl = DynaWeb.WebRequest.ByUrl(url=code_block_2)
code_block_3 = CodeBlock { "my API key"; }
code_block_4 = CodeBlock(appiKey=code_block_3) { "Authorization"; appiKey; "Bearer "+appiKey; }
addHeader = DynaWeb.WebRequest.AddHeader(webRequest=byUrl, name=code_block_4.out0, value=code_block_4.out2)

# group: Set the request method
code_block_5 = CodeBlock { "POST"; }
setMethod = DynaWeb.WebRequest.SetMethod(webRequest=addHeader, method=code_block_5)

# group: Build the body of the request
code_block_6 = CodeBlock { "records"; }
code_block_7 = CodeBlock { "fields"; }
code_block_8 = CodeBlock()
# ---------- code_block_8.designscript (3 lines) ----------
["Code","Material","Width","Height","Fire Rating","Level","Frame Finish","Doorstop"];
["328","Steel",1830,2134,"3 Hours","01 - Entry Level","Epoxy powder primed","None"];
["329","Steel",1830,2134,"3 Hours","01 - Entry Level","Epoxy powder primed","None"];
# ----------------------------------------
byKeysValues = DesignScript.Builtin.Dictionary.ByKeysValues(keys=code_block_8.out0, values=code_block_8.out1)
byKeysValues_2 = DesignScript.Builtin.Dictionary.ByKeysValues(keys=code_block_7, values=byKeysValues)
code_block_9 = CodeBlock { "fields"; }
byKeysValues_3 = DesignScript.Builtin.Dictionary.ByKeysValues(keys=code_block_8.out0, values=code_block_8.out2)
byKeysValues_4 = DesignScript.Builtin.Dictionary.ByKeysValues(keys=code_block_9, values=byKeysValues_3)
list_create = List.Create(item0=byKeysValues_2, item1=byKeysValues_4)
list_create_2 = List.Create(item0=list_create)
byKeysValues_5 = DesignScript.Builtin.Dictionary.ByKeysValues(keys=code_block_6, values=list_create_2)
watch = Watch(byKeysValues_5)

# group: Add the body to the request
string = StringInput("application/json")
stringifyJSON = Data.StringifyJSON(values=byKeysValues_5)
string_2 = StringInput("RequestBody")
addParameter = DynaWeb.WebRequest.AddParameter(webRequest=setMethod, name=string, value=stringifyJSON, parameterType=string_2, lacing=Shortest)

# group: Send the request
execute = DynaWeb.WebRequest.Execute(request=addParameter)
content = DynaWeb.WebResponse.Content(webResponse=execute)

# group: Write the content of the response
file_path = Filename("G:\My Drive\02 - BIM 42\01 - Posts\20200626 - DynaWeb\returnValue.txt")
writeText = FileSystem.WriteText(filePath=file_path, text=content)
