# Dynamo graph AirTable-DeleteLine.dyn (Dynamo 2.6.0.8481)
# packages: DynaWeb 1.0.3

code_block = CodeBlock { "https://api.airtable.com/v0/"; "appzH3UCTvVsrXqZU"; "doors"; }
code_block_2 = CodeBlock { "recdhhO5vq8pn8m3i"; }
code_block_3 = CodeBlock(airtableUrl=code_block.out0, baseId=code_block.out1, tableName=code_block.out2, recordId=code_block_2)
# ---------- code_block_3.designscript (4 lines) ----------
airtableUrl+
baseId+"/"+
tableName+"/"+
recordId;
# ----------------------------------------
byUrl = DynaWeb.WebRequest.ByUrl(url=code_block_3)
code_block_4 = CodeBlock { "my API Key"; }
code_block_5 = CodeBlock(appiKey=code_block_4) { "Authorization"; appiKey; "Bearer "+appiKey; }
addHeader = DynaWeb.WebRequest.AddHeader(webRequest=byUrl, name=code_block_5.out0, value=code_block_5.out2)
code_block_6 = CodeBlock { "DELETE"; }
setMethod = DynaWeb.WebRequest.SetMethod(webRequest=addHeader, method=code_block_6)
execute = DynaWeb.WebRequest.Execute(request=setMethod)
content = DynaWeb.WebResponse.Content(webResponse=execute)

# group: Write the content of the response
file_path = Filename("G:\My Drive\02 - BIM 42\01 - Posts\20200626 - DynaWeb\returnValue.txt")
writeText = FileSystem.WriteText(filePath=file_path, text=content)
