# Dynamo graph AirTable-Get.dyn (Dynamo 2.6.0.8481)
# packages: DynaWeb 1.0.3

file_path = Filename("G:\My Drive\02 - BIM 42\01 - Posts\20200626 - DynaWeb\returnValue.txt")
url_parts = CodeBlock { "https://api.airtable.com/v0/"; "appzH3UCTvVsrXqZU"; "doors"; }
build_the_enpoint = CodeBlock(airtableUrl=url_parts.out0, baseId=url_parts.out1, tableName=url_parts.out2)
# ---------- build_the_enpoint.designscript (3 lines) ----------
airtableUrl+
baseId+"/"+
tableName;
# ----------------------------------------
byUrl = DynaWeb.WebRequest.ByUrl(url=build_the_enpoint)
code_block = CodeBlock { "my API key"; }
code_block_2 = CodeBlock(appiKey=code_block) { "Authorization"; appiKey; "Bearer "+appiKey; }
addHeader = DynaWeb.WebRequest.AddHeader(webRequest=byUrl, name=code_block_2.out0, value=code_block_2.out2)
execute = DynaWeb.WebRequest.Execute(request=addHeader)
content = DynaWeb.WebResponse.Content(webResponse=execute)
writeText = FileSystem.WriteText(filePath=file_path, text=content)
deserialise = DynaWeb.Helpers.Deserialise(json=content)
code_block_3 = CodeBlock { "records"; }
valueAtKey = DesignScript.Builtin.Dictionary.ValueAtKey(dictionary=deserialise, key=code_block_3)
code_block_4 = CodeBlock { "fields"; }
valueAtKey_2 = DesignScript.Builtin.Dictionary.ValueAtKey(dictionary=valueAtKey, key=code_block_4)
code_block_5 = CodeBlock { "Code"; "Doorstop"; }
valueAtKey_3 = DesignScript.Builtin.Dictionary.ValueAtKey(dictionary=valueAtKey_2, key=code_block_5.out0)
valueAtKey_4 = DesignScript.Builtin.Dictionary.ValueAtKey(dictionary=valueAtKey_2, key=code_block_5.out1)
watch = Watch(build_the_enpoint)
