# Dynamo graph AirTable-GetLine.dyn (Dynamo 2.6.0.8481)
# packages: DynaWeb 1.0.3, Orchid 250.0.1.7472

code_block = CodeBlock { "my API key"; }
code_block_2 = CodeBlock(appiKey=code_block) { "Authorization"; appiKey; "Bearer "+appiKey; }

# group: Get the list of records
code_block_3 = CodeBlock { "https://api.airtable.com/v0/"; "appzH3UCTvVsrXqZU"; "doors"; }
code_block_4 = CodeBlock(airtableUrl=code_block_3.out0, baseId=code_block_3.out1, tableName=code_block_3.out2)
# ---------- code_block_4.designscript (3 lines) ----------
airtableUrl+
baseId+"/"+
tableName;
# ----------------------------------------
watch = Watch(code_block_4)
byUrl = DynaWeb.WebRequest.ByUrl(url=code_block_4)
addHeader = DynaWeb.WebRequest.AddHeader(webRequest=byUrl, name=code_block_2.out0, value=code_block_2.out2)
execute = DynaWeb.WebRequest.Execute(request=addHeader)
content = DynaWeb.WebResponse.Content(webResponse=execute)

# group: Deserialise the response and get the id of the first record
deserialise = DynaWeb.Helpers.Deserialise(json=content)
code_block_5 = CodeBlock { "records"; }
valueAtKey = DesignScript.Builtin.Dictionary.ValueAtKey(dictionary=deserialise, key=code_block_5)
code_block_6 = CodeBlock { "id"; }
valueAtKey_2 = DesignScript.Builtin.Dictionary.ValueAtKey(dictionary=valueAtKey, key=code_block_6)
firstItem = List.FirstItem(list=valueAtKey_2)

# group: Get a specific record
url_parts = CodeBlock { "https://api.airtable.com/v0/"; "appzH3UCTvVsrXqZU"; "doors"; }
build_the_url = CodeBlock(airtableUrl=url_parts.out0, baseId=url_parts.out1, tableName=url_parts.out2, recordId=firstItem)
# ---------- build_the_url.designscript (4 lines) ----------
airtableUrl+
baseId+"/"+
tableName+"/"+
recordId;
# ----------------------------------------
byUrl_2 = DynaWeb.WebRequest.ByUrl(url=build_the_url)
addHeader_2 = DynaWeb.WebRequest.AddHeader(webRequest=byUrl_2, name=code_block_2.out0, value=code_block_2.out2)
await_ = Orchid.Common.DataStream.Await(pass=addHeader_2, waitFor=firstItem)
execute_2 = DynaWeb.WebRequest.Execute(request=await_)
content_2 = DynaWeb.WebResponse.Content(webResponse=execute_2)
watch_2 = Watch(build_the_url)

# group: Write the content of the response
file_path = Filename("G:\My Drive\02 - BIM 42\01 - Posts\20200626 - DynaWeb\returnValue.txt")
writeText = FileSystem.WriteText(filePath=file_path, text=content_2)
