# Dynamo graph AirTable-UpdateLine.dyn (Dynamo 2.6.0.8481)
# packages: DynaWeb 1.0.3

# group: Build the request
code_block = CodeBlock { "https://api.airtable.com/v0/"; "appzH3UCTvVsrXqZU"; "doors"; }
code_block_2 = CodeBlock(airtableUrl=code_block.out0, baseId=code_block.out1, tableName=code_block.out2)
# ---------- code_block_2.designscript (3 lines) ----------
airtableUrl+
baseId+"/"+
tableName;
# ----------------------------------------
byUrl = DynaWeb.WebRequest.ByUrl(url=code_block_2)
code_block_3 = CodeBlock { "my API Key"; }
code_block_4 = CodeBlock(appiKey=code_block_3) { "Authorization"; appiKey; "Bearer "+appiKey; }
addHeader = DynaWeb.WebRequest.AddHeader(webRequest=byUrl, name=code_block_4.out0, value=code_block_4.out2)

# group: set the PATCH method
code_block_5 = CodeBlock { "PATCH"; }
setMethod = DynaWeb.WebRequest.SetMethod(webRequest=addHeader, method=code_block_5)

# group: Build the body of the request
code_block_6 = CodeBlock { "records"; }
code_block_7 = CodeBlock { ["id","fields"]; }
code_block_8 = CodeBlock { "recNw3NfVtjlgePdI"; }
code_block_9 = CodeBlock { ["Material","Fire Rating"]; ["Wood","3 Hours"]; }
byKeysValues = DesignScript.Builtin.Dictionary.ByKeysValues(keys=code_block_9.out0, values=code_block_9.out1)
list_create = List.Create(item0=code_block_8, item1=byKeysValues)
byKeysValues_2 = DesignScript.Builtin.Dictionary.ByKeysValues(keys=code_block_7, values=list_create)
list_create_2 = List.Create(item0=byKeysValues_2)
list_create_3 = List.Create(item0=list_create_2)
byKeysValues_3 = DesignScript.Builtin.Dictionary.ByKeysValues(keys=code_block_6, values=list_create_3)
watch = Watch(byKeysValues_3)

# group: Add the body
string = StringInput("application/json")
stringifyJSON = Data.StringifyJSON(values=watch)
string_2 = StringInput("RequestBody")
addParameter = DynaWeb.WebRequest.AddParameter(webRequest=setMethod, name=string, value=stringifyJSON, parameterType=string_2, lacing=Shortest)

execute = DynaWeb.WebRequest.Execute(request=addParameter)
content = DynaWeb.WebResponse.Content(webResponse=execute)

# group: Write the content of the response
file_path = Filename("G:\My Drive\02 - BIM 42\01 - Posts\20200626 - DynaWeb\returnValue.txt")
writeText = FileSystem.WriteText(filePath=file_path, text=content)
