# Dynamo graph AreaBoundaryFromCAD.dyn (Dynamo 2.5.0.7460)
# packages: bimorphNodes 3.0.3, DynamoMEP 1.0.0

# group: Select the imported DWG
select_model_element = DSModelElementSelection()  # 1 picked in the model

# group: Convert the DWG to curves
curvesFromCADLayers = CAD.CurvesFromCADLayers(importInstance=select_model_element)

# group: Create area boundaries from these curves
views = Views("Area - Level 0")
byCurveAndView = DynamoMEP.AreaBoundary.ByCurveAndView(curve=curvesFromCADLayers.Curve, view=views)
