# Dynamo graph CreateAreaFromFloor.dyn (Dynamo 2.5.0.7460)
# packages: DynamoMEP 1.0.0

# group: Select slabs and get their faces
select_model_elements = DSModelElementsSelection()  # 4 picked in the model
faces = Element.Faces(element=select_model_elements)

# group: Filter for the upper face
flatten = List.Flatten(list=faces)
code_block = CodeBlock { 0.5; }
normalAtParameter = Surface.NormalAtParameter(u=code_block, v=code_block)  # unwired: surface
Z = Vector.Z()  # unwired: vector
code_block_2 = CodeBlock { 1; }
eq = _ == code_block_2  # unwired: x
function_compose = ComposeFunctions(func0=normalAtParameter, func1=Z, func2=eq)
filter = List.Filter(list=flatten, condition=function_compose)

# group: Group and sort slabs faces by elevation
code_block_3 = CodeBlock { 0.1; }
pointAtParameter = Surface.PointAtParameter(u=code_block_3, v=code_block_3)  # unwired: surface
Z_2 = Point.Z()  # unwired: point
function_compose_2 = ComposeFunctions(func0=pointAtParameter, func1=Z_2)
sortByFunction = List.SortByFunction(list=filter.in, func=function_compose_2)
groupByFunction = List.GroupByFunction(list=sortByFunction, func=function_compose_2)

# group: Create a list of area plan views
views = Views("Rentable - 01 - Entry Level")
views_2 = Views("Rentable - 02 - Floor")
views_3 = Views("Rentable - 03 - Floor")
list_create = List.Create(item0=views, item1=views_2, item2=views_3)

# group: Create area boundaries
perimeterCurves = Surface.PerimeterCurves(surface=groupByFunction@L2)
byCurveAndView = DynamoMEP.AreaBoundary.ByCurveAndView(curve=perimeterCurves@L3, view=list_create@L1)

# group: Create areas
code_block_4 = CodeBlock { 0.1; }
pointAtParameter_2 = Surface.PointAtParameter(surface=groupByFunction, u=code_block_4, v=code_block_4)
byPointAndView = DynamoMEP.Area.ByPointAndView(point=pointAtParameter_2, areaView=list_create)
