# Dynamo graph DoorOpeningSide.dyn (Dynamo 2.5.0.7460)
# packages: DynamoMEP 1.0.1

# group: Get all rooms
categories = Categories("OST_Rooms")
all_elements_of_category = ElementsOfCategory(Category=categories)

# group: Get the doors of a room
doors = DynamoMEP.Room.Doors(room=all_elements_of_category)

# group: Get the "Front" reference plane
familyInstanceReferenceType = FamilyInstanceReferenceTypeDropDown("Front")
getReferencesPlanesByType = DynamoMEP.FamilyInstance.GetReferencesPlanesByType(familyInstance=doors, familyInstanceReferenceType=familyInstanceReferenceType)

# group: Create a point on the opening side of the door
code_block = CodeBlock { 0.2; }
byCoordinates = Point.ByCoordinates(z=code_block)
byPlane = CoordinateSystem.ByPlane(plane=getReferencesPlanesByType)
transform = Geometry.Transform(geometry=byCoordinates, cs=byPlane)

isInsideRoom = Room.IsInsideRoom(room=all_elements_of_category, point=transform)
