# Dynamo graph LinkRoomToSpaces.dyn (Dynamo 2.0.2.6826)

categories = Categories(index=137)
all_elements_of_category = ElementsOfCategory(Category=categories)
fromElement = DynamoMEP.Space.FromElement(element=all_elements_of_category)
code_block = CodeBlock { "Commentaires"; }
get_documents = Custom[Get Documents]()  # Queries all linked Revit files and retrieves their Name, LinkInstance and Document properties.
categories_2 = Categories(index=394)
getFromLinkedFile = Custom[Element.GetFromLinkedFile](Link_Instance=get_documents.Link_Instance, Link_Document=get_documents.Link_Doc, Category=categories_2)  # Get elements from link document instance based on category
locationPoint = DynamoMEP.Space.LocationPoint(space=fromElement)
location = Room.Location(room=getFromLinkedFile)
distanceTo = Geometry.DistanceTo(geometry=locationPoint, other=location, lacing=CrossProduct)
sortByKey = List.SortByKey(list=getFromLinkedFile@L2, keys=distanceTo@L2, lacing=Longest)
firstItem = List.FirstItem(list=sortByKey.sorted_list)
code_block_2 = CodeBlock { "Numéro"; }
getParameterValueByName = Element.GetParameterValueByName(element=firstItem, parameterName=code_block_2)
setParameterByName = Element.SetParameterByName(element=fromElement, parameterName=code_block, value=getParameterValueByName)
