# Dynamo graph PlaceInRoom.dyn (Dynamo 2.5.0.7460)
# packages: DynamoMEP 0.0.2

byFace = FamilyInstance.ByFace()  # unwired: familyType, face, location, referenceDirection
family_types = FamilyTypes("M_Switch:Fan")
categories = Categories("OST_Rooms")
all_elements_of_category = ElementsOfCategory(Category=categories)
doors = DynamoMEP.Room.Doors(room=all_elements_of_category)
boundingBox = Element.BoundingBox(element=doors)
getHost = FamilyInstance.GetHost(familyInstance=doors)
geometry = Element.Geometry(element=getHost)
bySolid = PolySurface.BySolid(solid=geometry)
surfaces = PolySurface.Surfaces(polySurface=bySolid)
code_block = CodeBlock { 2; }
normalizeDepth = List.NormalizeDepth(list=surfaces, rank=code_block)
location = Room.Location(room=all_elements_of_category)
distanceTo = Geometry.DistanceTo(geometry=normalizeDepth, other=location)
minimumItem = List.MinimumItem(list=distanceTo)
indexOf = List.IndexOf(list=distanceTo@L2, element=minimumItem@L1)
getItemAtIndex = List.GetItemAtIndex(list=normalizeDepth@L2, index=indexOf@L1)
