# Dynamo graph PlacePendantLights.dyn (Dynamo 2.5.0.7460)
# packages: DynamoMEP 1.0.1

# group: Select a room and create a 2-meters spaced points grid in it
select_model_element = DSModelElementSelection()  # 1 picked in the model
code_block = CodeBlock { 2; }
grid = DynamoMEP.Room.Grid(room=select_model_element, step=code_block)

# group: Find points on the ceilling
ZAxis = Vector.ZAxis()
translate = Geometry.Translate(geometry=grid, direction=ZAxis)
code_block_2 = CodeBlock { 1; }
views = Views("{3D}")
byOriginDirection = Revit.References.RayBounce.ByOriginDirection(origin=translate, direction=ZAxis, maxBounces=code_block_2, view=views)

# group: Find the underside face of the ceiling
faces = Element.Faces(element=byOriginDirection.elements)
normalAtPoint = Surface.NormalAtPoint(surface=faces, point=byOriginDirection.points)
Z = Vector.Z(vector=normalAtPoint)
code_block_3 = CodeBlock { -1; }
eq = Z == code_block_3
filterByBoolMask = List.FilterByBoolMask(list=faces, mask=eq)

# group: Create the face-based family instance
XAxis = Vector.XAxis()
byFace = FamilyInstance.ByFace(face=filterByBoolMask.in, location=byOriginDirection.points, referenceDirection=XAxis)  # unwired: familyType
family_types = FamilyTypes("M_Pendant Light - Disk:150W - 277V")
