# Dynamo graph WFC - OfficeSpace.dyn "Office" (Dynamo 2.5.0.7460)
# packages: DynamoMEP 1.0.1

# group: Create a grid of points
code_block = CodeBlock { 0; s=2.7; s2=(-1)*s; 14*s; 14*s2; }
range = Range(start=code_block.out0, end=code_block.out3, step=code_block.s)
range_2 = Range(start=code_block.out0, end=code_block.out4, step=code_block.s2)
byCoordinates = Point.ByCoordinates(x=range, y=range_2, lacing=CrossProduct)

# group: Get the Group type for each position on the grid
code_block_2 = CodeBlock { ["Corner - Bottom","Corner - Left","Corner - Right","Corner - Top","InnerCorner - Bottom","InnerCorner - Left","InnerCorner - Right","InnerCorner - Top","Facade - Bottom","Facade - Left","Facade - Right","Facade - Top","Office - Bottom","Office - Left","Office - Right","Office - Top","Void"]; }
fromName = DynamoMEP.GroupType.FromName(name=code_block_2)
file_path = Filename("C:\Users\Simon\Downloads\WFC\grid.csv")
importCSV = Data.ImportCSV(filePath=file_path)
code_block_3 = CodeBlock { 1; }
sub = importCSV - code_block_3
getItemAtIndex = List.GetItemAtIndex(list=fromName, index=sub)

# group: Place group instances
placeGroupInstance = DynamoMEP.Group.PlaceGroupInstance(point=byCoordinates, groupType=getItemAtIndex)
